# Grasshopper definition TerrainTiles.gh (Grasshopper 1.0.7)
# plug-ins: MeshEdit Components

tiles_x_y_num = Panel("512")
ground_resolution_m = Panel("29")

# ---- group: ELEVATION .csv
path = FilePath("C:\Users\marco\Google Drive\Colab Notebooks\TILE_X1147_Y777_Z11_ELEVATION.csv")

# ---- group: COLOR .csv
path_2 = FilePath("C:\Users\marco\Google Drive\Colab Notebooks\TILE_X1147_Y777_Z11_COLOR.csv")

# ----
file = ReadFile(F=path_2, PerLineParse=True)  # -> C
#   port F: Uri of file to read
# ---------- file: VB line parser ----------
    action = GH_LineParserAction.Include
    
    Return line

    'Parse the line and return some data that represents the line.
    'If the line cannot be parsed, you can return Nothing and
    'assign a different action.
    'The default implementation is to just return the line itself.
    'If you return types that implement IGH_Goo, this component
    'will work substantially faster.
# ---------- end file ----------
file_2 = ReadFile(F=path, PerLineParse=True)  # -> C; same code as file
multiplication = Multiplication(A=ground_resolution_m, B=tiles_x_y_num)
rev = ReverseList(List=file)
rev_2 = ReverseList(List=file_2)
rectangle = Rectangle(Plane=PlaneXY(0, 0, 0), XSize=multiplication, YSize=multiplication, Radius=0)  # -> Rectangle, Length
split = TextSplit(Text=rev, Separators=";")  # -> flatten(Result)
split_2 = TextSplit(Text=rev_2, Separators=";")  # -> flatten(Result)
mplane = MeshPlane(Boundary=rectangle.Rectangle, WidthCount=tiles_x_y_num, HeightCount=tiles_x_y_num)  # -> Mesh, Area
facen = FaceNormals(Mesh=mplane.Mesh)  # -> Centers, Normals
c_script = CSharpScript(V=split)  # -> C; inputs V: list of String
# ---------- c_script: C# usings ----------
using System.Linq;
using System.Drawing;
# ---------- c_script: C# ----------
    // convert list of strings to list of int
    List<int> values = new List<int>();
    values = V.Select(int.Parse).ToList();
    List<Color> colors = new List<Color>();

    for (int i = 0; i < V.Count - 2; i+=3)
    {
      Color c = Color.FromArgb(255, values[i], values[i + 1], values[i + 2]);
      colors.Add(c);
    }

    C = colors;
# ---------- end c_script ----------
c_script_2 = CSharpScript(V=split_2)  # -> Z; inputs V: list of String
# ---------- c_script_2: C# ----------
    // convert list of strings to list of int
    List<int> values = new List<int>();
    values = V.Select(int.Parse).ToList();
    List<int> elevations = new List<int>();

    for (int i = 0; i < V.Count; i++)
    {
      elevations.Add(values[i]);
    }

    Z = elevations;
# ---------- end c_script_2 ----------
Z = UnitZ(Factor=c_script_2)
move = Move(Geometry=facen.Centers, Motion=Z)  # -> Geometry, Transform
frompoints = MeshFromPoints(Points=move.Geometry, UDirection=tiles_x_y_num, VDirection=tiles_x_y_num, Colour=c_script)
flip = MeshFlip(Mesh=frompoints)
mesh = Mesh(flip)
